# Grasshopper definition KarambaIDEA_Example_Truss.gh (Grasshopper 1.0.7)
# Copyright: B+G Engineers
# plug-ins: KarambaIDEA, karambaGH

# ---- group: Parameters
# KarambaIDEA Example Truss
length = Slider(10, range=0..30)
structure_height = Slider(4, range=0..10)
truss_height = Slider(1, range=0..5)
truss_divisions = Slider(4, range=2..20)
connection_truss_column = ValueList({"Moment": 0, "Hinge": 1}, selected="Hinge")

# ---- group: Geometry
X = UnitX(Factor=length)
pt = ConstructPoint(XCoordinate=0, YCoordinate=0, ZCoordinate=0)
move = Move(Geometry=pt, Motion=X)  # -> Geometry, Transform
pt_2 = Point(move.Geometry)
pt_3 = Point(pt)
ln = Line(StartPoint=pt, EndPoint=pt_2)
subtraction = Subtraction(A=structure_height, B=truss_height)
aligndim = AlignedDimension(Plane=PlaneXY(0, 0, 0), PointA=pt, PointB=pt_2, Offset=-1, Text="{0:0.00}", Size=0.2)
Z = UnitZ(Factor=structure_height)
Z_2 = UnitZ(Factor=subtraction)
divide = DivideCurve(Curve=ln, Count=truss_divisions, Kinks=False)  # -> Points, Tangents, Parameters
move_2 = Move(Geometry=divide.Points, Motion=Z_2)  # -> Geometry, Transform
move_3 = Move(Geometry=divide.Points, Motion=Z)  # -> Geometry, Transform
pt_4 = Point([pt_3, pt_2])

# ----
panel = Panel("""Parameters
Geometry
Karamba3D
KarambaIDEA
3. Project utilities
4. IDEA utilities
5. IDEA templates""")
merge = Merge(
    Data1=ColourSwatch(SwatchColor=RGB(106, 144, 173)),
    Data2=ColourSwatch(SwatchColor=RGB(123, 189, 179)),
    Data3=ColourSwatch(SwatchColor=RGB(227, 136, 118)),
    Data4=ColourSwatch(SwatchColor=RGB(237, 221, 161)),
    Data5=ColourSwatch(SwatchColor=RGB(186, 222, 214)),
    Data6=ColourSwatch(SwatchColor=RGB(250, 227, 217)),
    Data7=ColourSwatch(SwatchColor=RGB(255, 181, 184)))
group_color = SliderGroupColor(run=Button(), groupNames=panel, colors=merge, defaultColor=ColourSwatch(SwatchColor=RGB(232, 227, 227)))  # inputs run: Boolean, groupNames: list of String, colors: list of Color, defaultColor: Color
# ---------- group_color: C# usings ----------
using System.Drawing;
using Grasshopper.Kernel.Special;
# ---------- group_color: C# ----------
    // Created by Timo Harboe Nielsen - Bjarke Ingels Group.
    
    if(!run){
      return;
    }
    GH_Document doc = owner.OnPingDocument();
    foreach (var dobj in doc.Objects)
    {
      GH_Group _group = dobj as GH_Group;
      if( _group == null){
        continue;
      }
      for(int i = 0; i < Math.Min(groupNames.Count, colors.Count); i++){
        string groupName = _group.NickName.ToString();
        string compareName = groupNames[i];
        if(groupName.IndexOf(compareName, StringComparison.OrdinalIgnoreCase) >= 0){
          _group.Colour = colors[i];
          break;
        } else{
          _group.Colour = defaultColor;
        }
      }
    }
# ---------- end group_color ----------

cluster = Cluster_8(pt=move_2.Geometry)
cluster_2 = Cluster(pt=cluster)  # -> flatten(L)

# ---- group: Karamba3D / Define Materials
matselect = MaterialSelectionKaramba3D(menu=[dropdown(1), dropdown(4)])

# ---- group: Karamba3D / Define Cross Sections
crosecrselect = CrossSectionRangeSelectorKaramba3D(MaximumHeight_cm=-1, MaximumWidth_cm=-1, Material=matselect, menu=[dropdown(1), dropdown(1), dropdown(4)])
crosecselect = CrossSectionSelectorKaramba3D(CrossSections=crosecrselect, NameOrListIndexOfCrossSection="4")  # -> CrossSection, Info
crosecselect_2 = CrossSectionSelectorKaramba3D(CrossSections=crosecrselect, NameOrListIndexOfCrossSection="0")  # -> CrossSection, Info
crosecselect_3 = CrossSectionSelectorKaramba3D(CrossSections=crosecrselect, NameOrListIndexOfCrossSection="2")  # -> CrossSection, Info
entwine = Entwine(
    Branch00=crosecselect.CrossSection,
    Branch01=crosecselect_3.CrossSection,
    Branch02=crosecselect_2.CrossSection,
    Branch03=crosecselect_2.CrossSection,
    FlattenInputs=True)

# ----
crosec = CrossSectionKaramba3D(crosecrselect)
load_multiplier = Slider(20, range=0..500)

# ---- group: Karamba3D / Define Supports
panel_2 = Panel("Diagonal")
beam_joints = BeamJointsKaramba(
    ElementIdentifiers=panel_2,
    CtKNMAtStartingNode=Vector(0, 0, 0),
    CrKNmRadAtStartingNode=Vector(0, 0, 0),
    CtKNMAtEndNode=Vector(0, 0, 0),
    CrKNmRadAtEndNode=Vector(0, 0, 0),
    menu=[buttons(off, off, off, off, on, off), buttons(off, off, off, off, on, off)])

# ----
Z_3 = UnitZ(Factor=load_multiplier)

# ---- group: Karamba3D / Define Loads
load_multiplier_2 = Slider(-50, range=-500..0)
Z_4 = UnitZ(Factor=load_multiplier_2)
loads = LoadsKaramba3D(Vector=Z_4, BeamIdentifiers="Topchord", LCase="0", mode="Uniform Line", menu=[buttons(off, on, off)])

# ----
loads_2 = LoadsKaramba3D(Vector=Z_3, BeamIdentifiers="Topchord", LCase="1", mode="Uniform Line", menu=[buttons(off, on, off)])
hierarchy = Panel("""Column
Topchord
Bottomchord
Post
Diagonal""")

# ---- group: 5. IDEA Templates
bolted_endplate_connection = BoltedEndplateConnection()

weld_all_members = WeldAllMembers()

# ----
groupnames = Panel("""Column
Topchord
Bottomchord""")

# ---- group: 3. Project utilities
dom = ConstructDomain(DomainStart="0", DomainEnd="1")
range = Range(Domain=dom, Steps=Slider(5, range=0..100))

# ---- group: Geometry
cluster_3 = Cluster_2(pt=move_2.Geometry)
cluster_4 = Cluster_2(pt=move_3.Geometry)
pt_5 = Point(move_3.Geometry)
pt_6 = Point(move_2.Geometry)
cluster_5 = Cluster(pt=move_3.Geometry)  # -> flatten(L)
cluster_6 = Cluster(pt=move_2.Geometry)  # -> flatten(L)
pt_7 = Point(pt_4)
pt_8 = Point(pt_4)
pt_9 = Point(cluster_3)
pt_10 = Point(cluster_4)
ln_2 = Line(StartPoint=pt_5, EndPoint=pt_6)  # -> flatten(Line)
lng = ListLength(List=pt_5)
lng_2 = ListLength(List=pt_6)
lng_3 = ListLength(List=pt_5)
lng_4 = ListLength(List=pt_6)
entwine_2 = Entwine(Branch00=pt_10, Branch01=pt_9, Branch02=pt_8, FlattenInputs=True)
split = SplitList(List=pt_5, Index=expr("(x/2)", lng))  # -> ListA, ListB
split_2 = SplitList(List=pt_6, Index=expr("x/2", lng_2))  # -> ListA, ListB
split_3 = SplitList(List=pt_5, Index=expr("(x/2)-1", lng_3))  # -> ListA, ListB
split_4 = SplitList(List=pt_6, Index=expr("(x/2)-1", lng_4))  # -> ListA, ListB
flip = FlipMatrix(Data=entwine_2)
cull_i = CullIndex(List=ln_2, Indices="0", Wrap=True)
pt_11 = Point(split.ListA)
pt_12 = Point(split_2.ListA)
pt_13 = Point(split_3.ListB)
pt_14 = Point(split_4.ListB)
cluster_7 = Cluster(pt=flip)  # -> flatten(L)
lng_5 = ListLength(List=cull_i)
lng_6 = ListLength(List=pt_11)
lng_7 = ListLength(List=pt_14)
cull_i_2 = CullIndex(List=pt_12, Indices="0", Wrap=True)
culln = CullNth(List=cull_i, CullFrequency=lng_5)
cull_i_3 = CullIndex(List=pt_13, Indices="0", Wrap=True)
culln_2 = CullNth(List=pt_11, CullFrequency=lng_6)
culln_3 = CullNth(List=pt_14, CullFrequency=lng_7)
ln_3 = Line(StartPoint=culln_2, EndPoint=cull_i_2)  # -> flatten(Line)
ln_4 = Line(StartPoint=culln_3, EndPoint=cull_i_3)  # -> flatten(Line)
merge_2 = Merge(Data1=ln_3, Data2=ln_4)
pt_15 = Point(pt_7)

# ----
filter = StreamFilter(Gate=connection_truss_column, Stream0=cluster_6, Stream1=cluster_2)

# ---- group: Geometry (continued)
entwine_3 = Entwine(Branch00=cluster_7, Branch01=cluster_5, Branch02=filter, Branch03=culln, Branch04=merge_2, FlattenInputs=True)

# ---- group: Karamba3D
pt_16 = Point(pt_15)
line = Line(entwine_3)

# ----
pt_17 = Point(pt_16)

# ---- group: Karamba3D / Define Elements
panel_3 = Panel("""Column
Topchord
Bottomchord
Post
Diagonal""")
linetobeam = LineToBeamKaramba3D(Line=line, Identifier=graft(panel_3), CrossSection=entwine, New=True, Remove=True, LimitDistance_m=0.005)  # -> Element, Points, Info

# ---- group: Karamba3D / Define Supports
supp = SupportKaramba(PosInd=pt_17, menu=[buttons(on, on, on, on, on, on)])

# ---- group: Karamba3D / Assemble Model
assemble = AssembleModelKaramba3D(Elem=flatten(linetobeam.Element), Support=supp, Load=[loads, loads_2], Joint=beam_joints, LimitDistance_m=0.005)  # -> Model, Info, Mass_kg, CenterOfGravity

# ---- group: Karamba3D / Analyze Model
analyze = AnalyzeKaramba3D(Model=assemble.Model)  # -> CalculatedModel, MaximumDisplacement_cm, ResultingForceOfGravity_kN, ElasticEnergy_kNm
panel_4 = Panel(analyze.MaximumDisplacement_cm)

# ----
opticrosec = OptimizeCrossSectionKaramba3D(
    Model=assemble.Model,
    GroupIdentifiers=panel_3,
    CrossSections=crosec,
    MaximumUtilization=1,
    MaximumDisplacement_cm=-1,
    UltimateLimitStateIterations=5,
    DisplacementIterations=5,
    NumberOfSamplePoints=3,
    ElasticDesign=True,
    GammaM0=1,
    GammaM1=1)  # -> ModelWithOptimizedCrossSections, Info, Mass_kg, MaximumDisplacement_cm, ElasticEnergy_kNm

# ---- group: Karamba3D / View Results
modelview = ModelViewKaramba3D(
    Model=opticrosec.ModelWithOptimizedCrossSections,
    LoadCaseFactorsForLinearSuperposition=1,
    IndexOfVisibleLoadcase=Slider(1, range=0..100))  # -> Model, DeformedMesh, DeformedAxes, DeformedModel
beamview = BeamViewKaramba3D(Model=modelview.Model)  # -> Model, MeshesOfRenderedBeams, DeformedBeamAxes, LegendColors, LegendTags

# ---- group: KarambaIDEA data transfer / Stream filter to control data speed
filter_2 = StreamFilter(Gate=Toggle(True), Stream1=beamview.Model)

# ---- group: KarambaIDEA data transfer / Data collect
disassemble = DisassembleModelKaramba3D(Model=filter_2)  # -> Model, Point, Beam, Shell, Support, Load, Line, Mesh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
k3dbeamprops = CSharpScript(
    Model=disassemble.Model,
    Reference=["C:\Program Files\Rhino 6\Plug-ins\karambaCommon.dll", "C:\Program Files\Rhino 6\Plug-ins\karamba.gha"])  # -> BeamIds, Material, CrosecNames, CrosecShapes, Heights, Widths, TFlanges, TWebs, FRads
# ---------- k3dbeamprops: C# usings ----------
using Karamba.Elements;
using Karamba.CrossSections;
# ---------- k3dbeamprops: C# ----------
    var model = Model as Karamba.Models.Model;
    if (model == null) {
      throw new ArgumentException ("The input is not of type model!");
    }

    var beam_ids = new List<string>();
    var cs_names = new List<string>();
    var cs_shapes = new List<string>();
    var cs_material = new List<string>();
    var heights = new List<double>();
    var widths = new List<double>();
    var tflanges = new List<double>();
    var twebs = new List<double>();
    var frads = new List<double>();

    foreach (var elem in model.elems)
    {
      var beam = elem as ModelElementStraightLine;
      if (beam != null) {
        beam_ids.Add(elem.id);
        cs_names.Add(elem.crosec.name);
        cs_shapes.Add(elem.crosec.shape());
        cs_material.Add(elem.crosec.materialName);

        // is it an I-profile?
        var crosec_i = beam.crosec as CroSec_I;
        if (crosec_i != null) {
          heights.Add(crosec_i.getHeight() * 1000);
          // use the upper flange thickness
          widths.Add(crosec_i.uf_width * 1000);
          tflanges.Add(crosec_i.uf_thick * 1000);
          twebs.Add(crosec_i.w_thick * 1000);
          // use the inner fillet radius
          frads.Add(crosec_i.fillet_r * 1000);
          // this would be the outer fillet radius
          // frads.Add(crosec.fillet_r1);
          continue;
        }

        // is it a CHS?
        var crosec_o = beam.crosec as CroSec_Circle;
        if (crosec_o != null) {
          heights.Add(crosec_o.getHeight() * 1000);
          // use the upper flange thickness
          widths.Add(0);
          tflanges.Add(crosec_o.thick * 1000);
          twebs.Add(crosec_o.thick * 1000);
          frads.Add(0);
          continue;
        }

        // options for Box, trapezoid and T-section are not implemented yet
        throw new Exception("Cross section encountered for which no export is implemented");
      }
    }

    BeamIds = beam_ids;
    CrosecNames = cs_names;
    CrosecShapes = cs_shapes;
    Material = cs_material;
    Heights = heights;
    Widths = widths;
    TFlanges = tflanges;
    TWebs = twebs;
    FRads = frads;
# ---------- end k3dbeamprops ----------
disassemble_2 = DisassembleElementKaramba3D(Element=disassemble.Beam)  # -> Element, ElementIdentifier, AxisOfElement, CrossSection, Joints, Material, LocalCoordinateSystem, ElementIsActive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
b_forces = BeamForcesKaramba3D(AnalyzedModel=disassemble.Model, LCase=-1, MaximumDistanceBetweenResults_m=-1, NumberOfResultsPerBeamElement=2)  # -> AnalyzedModel, NormalForce_kN, ShearForceVz_kN, ShearForceVy_kN, BendingMomentMt_kNm, BendingMomentMy_kNm, BendingMomentMz_kNm

# ---- group: KarambaIDEA data transfer
# KarambaIDEA
cp = CreateProject(
    Hierarchy=hierarchy,
    Points=disassemble.Point,
    Lines=disassemble.Line,
    LCSRotations_Deg=disassemble_2.Alpha_deg,
    Groupnames=k3dbeamprops.BeamIds,
    Materials=k3dbeamprops.Material,
    CrossSectionNames=k3dbeamprops.CrosecNames,
    Shapes=k3dbeamprops.CrosecShapes,
    Heights=k3dbeamprops.Heights,
    Widths=k3dbeamprops.Widths,
    ThicknessFlanges=k3dbeamprops.TFlanges,
    ThicknessWebs=k3dbeamprops.TWebs,
    Radius=k3dbeamprops.FRads,
    N=b_forces.NormalForce_kN,
    Vz=b_forces.ShearForceVz_kN,
    Vy=b_forces.ShearForceVy_kN,
    Mt=b_forces.BendingMomentMt_kNm,
    My=b_forces.BendingMomentMy_kNm,
    Mz=b_forces.BendingMomentMz_kNm)

# ---- group: 3. Project utilities
# Transport Elements Generator
number_slider = Slider(9, range=0..15)
transport_elements_generator = TransportElementsGenerator(Project=cp, GroupNames=groupnames, MaxLength=number_slider, MaxAngle_rad=Slider(1, range=0..3))  # -> TransportElementLines, AllElementLines
lng_8 = ListLength(List=transport_elements_generator.TransportElementLines)
cluster_8 = Cluster_6(data=transport_elements_generator.AllElementLines)
data = Data(flatten(cluster_8))
cluster_9 = Cluster_7(C=cluster_8)
lng_9 = ListLength(List=data)
total_elements = Panel(lng_9)
summary = Panel(cluster_9)

# ---- group: 4. IDEA utilities
# Create ideaCon file
toggle = BooleanToggle(False)
output_folderpath = Panel("C:\Data")
create_idea_file = CreateIDEAFile(
    Project=cp,
    OutputFolder=output_folderpath,
    Template=weld_all_members,
    RunAllJoints=toggle,
    ChooseJoint=Slider(2, range=0..100),
    RunIDEA=Button())

# ---- group: 3. Project utilities
# Weld volume generator
line_2 = Line(disassemble.Line)
show_weldsizes = BooleanToggle(True)
position = Slider(0.2, range=0..1)
textsize = Slider(0.02, range=0..0.15)
weld_volume_generator = WeldVolumeGenerator(Project=cp)  # -> WeldVolume_cm3, ThroatsBeginOfElement, ThroatsEndOfElement
expression = Expression(x=position, Expression="1-x")
eval = EvaluateCurve(Curve=line_2, Parameter=position)  # -> Point, Tangent, Angle
eval_2 = EvaluateCurve(Curve=line_2, Parameter=expression)  # -> Point, Tangent, Angle
filter_3 = StreamFilter(Gate=show_weldsizes, Stream0=flatten("0"), Stream1=textsize)
rad = Radians(Degrees=Slider(-12, range=-100..100))
xz = XZPlane(Origin=eval.Point)
xz_2 = XZPlane(Origin=eval_2.Point)
rotate = Rotate(Geometry=xz_2, Angle=rad, Plane=xz_2)  # -> Geometry, Transform
rotate_2 = Rotate(Geometry=xz, Angle=rad, Plane=xz)  # -> Geometry, Transform
txt = Text(weld_volume_generator.ThroatsBeginOfElement)
txt_2 = Text(weld_volume_generator.ThroatsEndOfElement)
cmyk = ColourCMYK(Cyan="1", Magenta="1", Yellow="1", Key="1")
tag = TextTag3D(Location=rotate_2.Geometry, Text=txt, Size=filter_3, Colour=cmyk, Justification="5")
tag_2 = TextTag3D(Location=rotate.Geometry, Text=txt_2, Size=filter_3, Colour=cmyk, Justification="5")

# ---- group: 4. IDEA utilities
# Create and Calculate ideaCon file
button = Button()
output_folderpath_2 = Panel("C:\Data")
create_idea_file_2 = CreateIDEAFile(
    Project=cp,
    OutputFolder=output_folderpath_2,
    Template=weld_all_members,
    ChooseJoint=Slider(9, range=0..100),
    RunIDEA=button)  # -> SelectedJoint, Analysis, Plates, Bolts, Welds, Buckling, Summary
cluster_10 = Cluster_5(T=create_idea_file_2.Analysis)
cluster_11 = Cluster_5(T=create_idea_file_2.Plates)
cluster_12 = Cluster_5(T=create_idea_file_2.Bolts)
cluster_13 = Cluster_5(T=create_idea_file_2.Welds)
cluster_14 = Cluster_5(T=create_idea_file_2.Summary)
summary_message = Panel(cluster_14)
ucplates = Panel(cluster_11)
ucbuckling = Panel(cluster_13)
analysis = Panel(cluster_10)
ucwelds = Panel(cluster_12)

# ---- group: 3. Project utilities
# Joint equilibrium
number_slider_2 = Slider(0.05, range=0..0.1)
loadcase = Slider(1, range=0..100)
joint_equilibrium = JointEquilibrium(Project=cp)  # -> XKN, YKN, ZKN, MtKN, MyKN, MzKN, Equilibrium
pt_18 = Point(disassemble.Point)
cluster_15 = Cluster_4(
    int=loadcase,
    data=joint_equilibrium.XKN,
    data_2=joint_equilibrium.YKN,
    data_3=joint_equilibrium.ZKN,
    data_4=joint_equilibrium.MtKN,
    data_5=joint_equilibrium.MyKN,
    data_6=joint_equilibrium.MzKN)  # -> flatten(R)
yz = YZPlane(Origin=pt_18)
tag_3 = TextTag3D(Location=yz, Text=cluster_15, Size=number_slider_2, Justification=7)

# Local coordinate system
lcs = LocalCoordinateSystem(Project=cp)  # -> LineOfElements, LocalXVectors, LocalYVectors, LocalZVectors
length_2 = Slider(0.149, range=0..2)
curvepoint = PointOnCurve(lcs.LineOfElements, parameter=0.182)
num = Number(length_2)
line_3 = LineSDL(Start=curvepoint, Direction=lcs.LocalXVectors, Length=num)
line_4 = LineSDL(Start=curvepoint, Direction=lcs.LocalYVectors, Length=num)
line_5 = LineSDL(Start=curvepoint, Direction=lcs.LocalZVectors, Length=num)
panel_5 = Panel("""255
0
0""")
entwine_4 = Entwine(Branch00=line_3, Branch01=line_4, Branch02=line_5, FlattenInputs=True)  # -> simplify(Result)
panel_6 = Panel("""0
255
0""")
panel_7 = Panel("""0
0
255""")
rgb = ColourRGB(Alpha=255, Red=panel_5, Green=panel_6, Blue=panel_7)  # -> graft(Colour)
pipe = Pipe(Curve=entwine_4, Radius=Slider(0.01, range=0..0.01), Caps=0)
pshift = ShiftPaths(Data=pipe, Offset=-1)
preview = CustomPreview(Geometry=pshift, Material=rgb)

# Visualize joints
toggle_2 = BooleanToggle(True)
data_2 = Data(cp)
textsize_2 = Slider(0.4, range=0..1)
spread = Slider(10, range=0..100)
move_along_x = Slider(26, range=0..100)
filter_4 = StreamFilter(Gate=toggle_2, Stream1=data_2)
visualize_joints = VisualizeJoints(Project=filter_4)  # -> JointTypes, Brandnames, Centerpoints
cluster_16 = Cluster_3(G=visualize_joints.JointTypes, data_3=spread, X=move_along_x)
cluster_17 = Cluster_3(G=visualize_joints.Centerpoints, data_3=spread, X=move_along_x)
pt_19 = Point(cluster_17)
line_6 = Line(cluster_16)
data_3 = Data(flatten(visualize_joints.Brandnames))
data_4 = Data(flatten(pt_19))
pipe_2 = Pipe(Curve=line_6, Radius="0.2", Caps=0)
xz_3 = XZPlane(Origin=data_4)
tag_4 = TextTag3D(Location=xz_3, Text=data_3, Size=textsize_2, Colour=ColourSwatch(SwatchColor=RGB(0, 0, 0)), Justification=7)

# ----
cluster_18 = Cluster_5(T=create_idea_file_2.Buckling)
ucbuckling_2 = Panel(cluster_18)

# ---- group: 3. Project utilities
data_5 = Data(flatten(transport_elements_generator.TransportElementLines))
data_6 = Data(flatten(lng_8))
data_7 = Data(range)
c_script = CSharpScript(lengths=data_6, colorlist=data_7)  # -> out, A; inputs lengths: list of Double, colorlist: list of Double
# ---------- c_script: C# ----------
    DataTree<double> tree = new DataTree<double>();
    GH_Path path = new GH_Path();
    int w = 0;


    for (int b = 0; b < lengths.Count; b++)
    {
      for (int c = 0;c < lengths[b];c++)
      {
        double num = colorlist[(w % colorlist.Count)];
        //tree.Add(num, path);
        tree.Add(num);
      }
      w = w + 1;

    }
    A = tree;
# ---------- end c_script ----------
data_8 = Data(flatten(c_script.A))
gradient = Gradient(
    LowerLimit=0,
    UpperLimit=1,
    Parameter=data_8,
    stops=[0: RGB(35, 99, 187), 0: RGB(234, 38, 0), 0: RGBA(255, 255, 255, 0), 0.25: RGB(234, 126, 0), 0.5: RGB(254, 244, 84), 0.75: RGB(173, 203, 249), 1: RGB(75, 107, 169)])
pipe_3 = Pipe(Curve=data_5, Radius=Slider(0.1, range=0..0.1), Caps=0)  # -> flatten(Pipe)
preview_2 = CustomPreview(Geometry=pipe_3, Material=gradient)

cluster_19 = Cluster_6(data=transport_elements_generator.AllElementLines)
linedim = LineDimension(Line=cluster_19, Text="{0:0.00}", Size=Slider(0.2, range=0..1))

# ---- group: 4. IDEA utilities
# Calculate ideaCon file
button_2 = Button()
filepath_ideacon_file = Panel("C:\Data\testHidden.ideaCon")
calculate_idea_file = CalculateIDEAFile(FilePath=filepath_ideacon_file, RunIDEA=button_2)  # -> Analysis, Plates, Bolts, Welds, Buckling, Summary
cluster_20 = Cluster_5(T=calculate_idea_file.Analysis)
cluster_21 = Cluster_5(T=calculate_idea_file.Plates)
cluster_22 = Cluster_5(T=calculate_idea_file.Bolts)
cluster_23 = Cluster_5(T=calculate_idea_file.Welds)
cluster_24 = Cluster_5(T=calculate_idea_file.Buckling)
analysis_2 = Panel(cluster_20)
ucplates_2 = Panel(cluster_21)
ucbuckling_3 = Panel(cluster_23)
ucwelds_2 = Panel(cluster_22)

# ----
cluster_25 = Cluster_5(T=calculate_idea_file.Summary)

# ---- group: 4. IDEA utilities (continued)
summary_message_2 = Panel(cluster_25)

# ----
ucbuckling_4 = Panel(cluster_24)

# ==== cluster Cluster
pt = ClusterInput()

pt_2 = Point(pt)
lng = ListLength(List=pt_2)
cull_i = CullIndex(List=pt_2, Indices="0", Wrap=True)
culln = CullNth(List=pt_2, CullFrequency=lng)
ln = Line(StartPoint=culln, EndPoint=cull_i)

L = ClusterOutput(ln)

# ==== cluster Cluster_2
pt = ClusterInput()
pt_2 = Point(pt)
lng = ListLength(List=pt_2)
item = ListItem(List=pt_2, Index=expr("x-1", lng), Wrap=True)
item_2 = ListItem(List=pt_2, Index="0", Wrap=True)
merge = Merge(Data1=item_2, Data2=item)
R = ClusterOutput(merge)

# ==== cluster Cluster_3
G = ClusterInput()
X = ClusterInput()
vec = VectorXYZ(XComponent=X, YComponent=0, ZComponent=0)  # -> Vector, Length
move = Move(Geometry=G, Motion=vec.Vector)  # -> Geometry, Transform
data = Data(move.Geometry)
tstat = TreeStatistics(Tree=data)  # -> Paths, Length, Count
dpath = DeconstructPath(Branch=tstat.Paths)
data_2 = Data(graft(tstat.Length))
flip = FlipMatrix(Data=dpath)
data_3 = ClusterInput()
bang = ExplodeTree(Data=flip)  # -> flatten(Branch0), flatten(Branch1)
data_4 = Data(data_3)
data_5 = Data(graft(bang.Branch0))
data_6 = Data(graft(bang.Branch1))
multiplication = Multiplication(A=bang.Branch0, B=data_4)
multiplication_2 = Multiplication(A=bang.Branch1, B=data_4)
path = ConstructPath(Indices=[data_5, data_6])  # -> flatten(Branch)
vec_2 = VectorXYZ(XComponent=multiplication, YComponent=multiplication_2, ZComponent=0)  # -> Vector, Length
unflatten = UnflattenTree(Tree=vec_2.Vector, Guide=path)  # -> graft(Tree)
data_7 = Data(flatten(data))
dup = DuplicateData(Data=unflatten, Number=data_2, Order=True)  # -> flatten(Data)
move_2 = Move(Geometry=data_7, Motion=dup)  # -> Geometry, Transform
G_2 = ClusterOutput(move_2.Geometry)
panel = Panel(move_2.Geometry)

# ==== cluster Cluster_4
data = ClusterInput()
data_2 = ClusterInput()
data_3 = ClusterInput()
data_4 = ClusterInput()
data_5 = ClusterInput()
data_6 = ClusterInput()
int = ClusterInput()
data_7 = Data(data)
data_8 = Data(data_2)
data_9 = Data(data_3)
data_10 = Data(data_4)
data_11 = Data(data_5)
data_12 = Data(data_6)
int_2 = Integer(int)
item = ListItem(List=data_7, Index=int_2, Wrap=True)
item_2 = ListItem(List=data_8, Index=int_2, Wrap=True)
item_3 = ListItem(List=data_9, Index=int_2, Wrap=True)
item_4 = ListItem(List=data_10, Index=int_2, Wrap=True)
item_5 = ListItem(List=data_11, Index=int_2, Wrap=True)
item_6 = ListItem(List=data_12, Index=int_2, Wrap=True)
lng = ListLength(List=item)
dup = DuplicateData(Data=", Mx kNm:", Number=lng, Order=True)  # -> simplify(Data)
dup_2 = DuplicateData(Data=", My kNm:", Number=lng, Order=True)  # -> simplify(Data)
dup_3 = DuplicateData(Data=", Mz kNm:", Number=lng, Order=True)  # -> simplify(Data)
dup_4 = DuplicateData(Data="X kN:", Number=lng, Order=True)  # -> simplify(Data)
dup_5 = DuplicateData(Data=", Y kN:", Number=lng, Order=True)  # -> simplify(Data)
dup_6 = DuplicateData(Data=", Z kN:", Number=lng, Order=True)  # -> simplify(Data)
merge = Merge(
    Data1=dup_4,
    Data2=item,
    Data3=dup_5,
    Data4=item_2,
    Data5=dup_6,
    Data6=item_3,
    Data7=dup,
    Data8=item_4,
    Data9=dup_2,
    Data10=item_5,
    Data11=dup_3,
    Data12=item_6)
join = TextJoin(Text=merge)
R = ClusterOutput(join)

# ==== cluster Cluster_5
T = ClusterInput()
join = TextJoin(Text=T)
rec = DataRecorder(join, DataLimit=2, RecordData=True)
item = ListItem(List=flatten(rec), Index=0, Wrap=True)
i = ClusterOutput(item)
panel = Panel(item)

# ==== cluster Cluster_6
data = ClusterInput()
data_2 = Data(data)
lng = ListLength(List=data_2)
item = ListItem(List=data_2, Index=expr("x-1", lng), Wrap=True)
item_2 = ListItem(List=data_2, Index=0, Wrap=True)
end = EndPoints(Curve=item_2)  # -> Start, End
end_2 = EndPoints(Curve=item)  # -> Start, End
ln = Line(StartPoint=end.Start, EndPoint=end_2.End)
L = ClusterOutput(ln)

# ==== cluster Cluster_7
C = ClusterInput()
len = Length(Curve=C)  # -> flatten(Length)
sort = SortList(Keys=len, ValuesA=len)  # -> Keys, ValuesA
dcon = DeleteConsecutive(Set=sort.Keys, Wrap=False)  # -> Set, Count
data = Data(graft(dcon.Set))
data_2 = Data(sort.Keys)
equals = Equality(FirstNumber=data_2, SecondNumber=data)  # -> simplify(Equality), Inequality
cull = CullPattern(List=data_2, CullPattern=equals.Equality)
lng = ListLength(List=cull)  # -> flatten(Length)
data_3 = Data(dcon.Set)
expression = Expression(x=lng, y=data_3, Expression="Format(\"There are {0:0} lines of {1:0.00} m\", x,y)")
R = ClusterOutput(expression)

# ==== cluster Cluster_8
pt = ClusterInput()
pt_2 = Point(pt)
cull_i = CullIndex(List=pt_2, Indices="0", Wrap=True)  # -> simplify(List)
lng = ListLength(List=cull_i)
culln = CullNth(List=cull_i, CullFrequency=lng)  # -> simplify(List)
L = ClusterOutput(culln)
panel = Panel(culln)
